# Grasshopper definition example_00.gh (Grasshopper 1.0.7)
# plug-ins: Vespidae

pipeline = GeometryPipeline(
    GroupByLayer=False,
    GroupByType=False,
    IncludeHidden=True,
    IncludeLocked=True,
    LayerFilter="*",
    NameFilter="*",
    SublayerFiltering=True,
    TypeFilter=4)
sort_curves = SortCurveComponent(Curves=pipeline)
vespmove = MoveComponent(Curve=sort_curves, Speed=Slider(6301, range=0..10000), ToolId="t0")
panel = Panel(vespmove)
solve = SolveActionsComponent(
    Actions=vespmove,
    RetractHeight=Slider(50, range=0..100),
    TravelSpeed=Slider(7183, range=0..10000),
    PartialRetract=Toggle(True))
expose_paths = ExposePaths(Vespmo=solve, ArrowScl=Slider(1.9, range=0..10))  # -> AllMoves, AllTravel, Arrows
vespmogcode = Vespmo_Gcode_Component(VESPMO=solve)
upload_gcode = UploadGcodeComponent(Gcode=vespmogcode, Filename="example_00", Ip="http://158.37.71.53", SendCode=Button())
